% Simulink data dictionary DataDictionary.sldd

FixedStepConfiguration = Simulink.ConfigSet(StartTime="0", StopTime="10*0.00833", FixedStep="0.00833", Solver="FixedStepDiscrete", ProdHWDeviceType="Atmel->AVR", SystemTargetFile="ert.tlc", HardwareBoard="Arduino Uno", TargetLang="C++")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
UseArduino = Simulink.Parameter(false, DataType="boolean")