# Requirement set SystemRequirements (R2018b)

## 1 [#1] Sensors (Container)

### 1.1 [#2] Proximity Sensors
The Self Navigating Robot shall have three digital switch sensors.

## 2 [#5] Actuation (Container)

### 2.1 [#4] Actuation
The Self Navigating Robot shall use two motors for steering and drive control.

### 2.2 [#13] Indication of turning
The self-navigating robot shall use LEDs to represent idicators when turning.

### 2.3 [#14] Indication of braking
The self-navigating robot shall use LEDs to represent brake lights when stopping.

### 2.4 [#15] Indication of reversing
The self-navigating robot shall have LEDs used to indicate when reversing.

## 3 [#6] Control (Container)

### 3.1 [#12] Manage motors
The Controller shall manage the demands to the motors depending on the sensor measurements.

### 3.2 [#18] H-Bridge Motor Control
The self-navigating robot shall use a H-Bridge for switching the motors.

### 3.3 [#16] Wireless Control
The self-navigating robot shall have a wireless transmitter

### 3.4 [#17] On-Off
The self-navigating robot shall have an on-off switch.

## 4 [#19] Justifications (Justification)

### 4.1 [#20] On-Off Switch Justification (Justification)
The On-Off Switch functionality will be achieved by hardware outside the software model.

### 4.2 [#21] H-Bridge Motor Control Justification (Justification)
The electrical control and protection circuit will be achieved through electronics outside of the software model.