% Requirement links of Controller.slx (R2018b)

block :1 implements SystemRequirements.slreqx#2: Proximity Sensors
block :19 implements ControllerRequirements.slreqx#4: Right-Collision
block :25 implements ControllerRequirements.slreqx#5: Front-Collision
block :31 implements ControllerRequirements.slreqx#7: Default Driving
block :4 implements SystemRequirements.slreqx#2: Proximity Sensors
block :40 implements SystemRequirements.slreqx#13: Indication of turning
block :41 implements SystemRequirements.slreqx#13: Indication of turning
block :42 implements SystemRequirements.slreqx#15: Indication of reversing
block :43 implements SystemRequirements.slreqx#14: Indication of braking
block :5 implements SystemRequirements.slreqx#2: Proximity Sensors
block :7 implements ControllerRequirements.slreqx#3: Left-Collision