# Requirement set ControllerRequirements (R2018b)

## 1 [#1] Controller Behaviour (Container)

### 1.1 [#3] Left-Collision
If the Left Proximity Sensor is triggered, then the Self Navigating Robot shall stop. Reverse. Then turn right 90 degrees before continuing to drive forward.

### 1.2 [#4] Right-Collision
If the Right Proximity Sensor is triggered, then the Self Navigating Robot shall stop. Reverse. Then turn left 90 degrees before continuing to drive forward.

### 1.3 [#5] Front-Collision
If the Front Proximity Sensor is triggered, then the Self Navigating Robot shall stop. Reverse. Then turn right 90 degrees before continuing to drive forward.

### 1.4 [#7] Default Driving
The normal drive control mode shall be for the Self Navigating Robot to drive forwards.