% Requirement links of SystemModel.slx (R2018b)

model implements SystemRequirements.slreqx#11: Manage motors
block :2 implements SystemRequirements.slreqx#11: Manage motors
block :22 implements SystemRequirements.slreqx#2: Proximity Sensors
block :29 implements SystemRequirements.slreqx#4: Actuation
block :3 implements SystemRequirements.slreqx#4: Actuation
block :31 implements SystemRequirements.slreqx#4: Actuation